# Dynamo graph ChangeViewTemplateTo1-500.dyn (Dynamo 1.3.0.875)

categories = Categories("Views")
all_elements_of_category = ElementsOfCategory(categories)
code_block = CodeBlock { "Dependency"; }
getParameterValueByName = Element.GetParameterValueByName(element=all_elements_of_category, parameterName=code_block)
string_from_object = FromObject(getParameterValueByName)
code_block_2 = CodeBlock { "Primary"; }
eq = string_from_object == code_block_2
code_block_3 = CodeBlock { "View Name"; }
getParameterValueByName_2 = Element.GetParameterValueByName(element=all_elements_of_category, parameterName=code_block_3)
string_from_object_2 = FromObject(getParameterValueByName_2)
code_block_4 = CodeBlock { "LT"; }
startsWith = String.StartsWith(str=string_from_object_2, searchFor=code_block_4)
and_ = eq && startsWith
code_block_5 = CodeBlock { "Rajz típus"; }
getParameterValueByName_3 = Element.GetParameterValueByName(element=all_elements_of_category, parameterName=code_block_5)
string_from_object_3 = FromObject(getParameterValueByName_3)
code_block_6 = CodeBlock { "Alaprajz"; }
startsWith_2 = String.StartsWith(str=string_from_object_3, searchFor=code_block_6)
and_2 = and_ && startsWith_2
filterByBoolMask = List.FilterByBoolMask(list=all_elements_of_category, mask=and_2)
view_templates = ViewTemplatesUi("Legtechnika 1-500")
setViewTemplate = Archilab.Grimshaw.Views.View.SetViewTemplate(filterByBoolMask.in, view_templates)
