# Dynamo graph ChangingDuctSystemColors.dyn (Dynamo 1.3.1.1736)

categories = Categories("DuctCurves")
all_elements_of_category = ElementsOfCategory(categories)
categories_2 = Categories("DuctTerminal")
all_elements_of_category_2 = ElementsOfCategory(categories_2)
categories_3 = Categories("FlexDuctCurves")
all_elements_of_category_3 = ElementsOfCategory(categories_3)
categories_4 = Categories("DuctFitting")
all_elements_of_category_4 = ElementsOfCategory(categories_4)
categories_5 = Categories("MechanicalEquipment")
all_elements_of_category_5 = ElementsOfCategory(categories_5)
join = List.Join(all_elements_of_category, all_elements_of_category_2, all_elements_of_category_3, all_elements_of_category_4, all_elements_of_category_5)
code_block = CodeBlock { "System Name"; }
getParameterValueByName = Element.GetParameterValueByName(element=join, parameterName=code_block)
string_from_object = FromObject(getParameterValueByName)
code_block_2 = CodeBlock(str=string_from_object) { str=="Mechanical Supply Air 17"; }
filterByBoolMask = List.FilterByBoolMask(list=join, mask=code_block_2)
code_block_3 = CodeBlock { 0; 200; 100; 255; }
byARGB = Color.ByARGB(a=code_block_3.out0, r=code_block_3.out1, g=code_block_3.out2, b=code_block_3.out3)
byProperties = Revit.Filter.OverrideGraphicSettings.ByProperties(byARGB, byARGB, byARGB, byARGB)
overrideInView = Element.OverrideInView(element=filterByBoolMask.in, overrides=byProperties)
boolean = BoolSelector(true)
overrideInView_2 = Element.OverrideInView(element=filterByBoolMask.out, hide=boolean)  # unwired: overrides
byARGB_2 = Color.ByARGB()
watch = Watch(filterByBoolMask.out)
current = Document.Current()
activeView = Document.ActiveView(current)
hideElements = Custom[View.HideElements](Element=filterByBoolMask.out, View=activeView, RunIt=boolean)  # This node will hide elements in specified view.
unhideElements = Custom[View.UnhideElements]()  # This node will unhide specified elemeints in given views.; unwired: Element, View
