# Dynamo graph Creating Sheets.dyn (Dynamo 1.3.0.875)

code_block = CodeBlock { "Test"; }
categories = Categories("Views")
all_elements_of_category = ElementsOfCategory(categories)
code_block_2 = CodeBlock { "View Name"; }
getParameterValueByName = Element.GetParameterValueByName(element=all_elements_of_category, parameterName=code_block_2)
string_from_object = FromObject(getParameterValueByName)
code_block_3 = CodeBlock { "M"; }
contains = String.Contains(str=string_from_object, searchFor=code_block_3)
not_ = Not(contains)
length = String.Length(string_from_object)
code_block_4 = CodeBlock(length=length) { length==8; }
code_block_5 = CodeBlock { "LT"; }
startsWith = String.StartsWith(str=string_from_object, searchFor=code_block_5)
and_ = code_block_4 && startsWith
and_2 = not_ && and_
filterByBoolMask = List.FilterByBoolMask(list=all_elements_of_category, mask=and_2)
getParameterValueByName_2 = Element.GetParameterValueByName(element=filterByBoolMask.in, parameterName=code_block_2)
string_from_object_2 = FromObject(getParameterValueByName_2)
code_block_6 = CodeBlock { 6; 2; }
substring = String.Substring(str=getParameterValueByName_2, startIndex=code_block_6.out0, length=code_block_6.out1)
byName = FamilyType.ByName(substring)
byNameNumberTitleBlockAndView = Sheet.ByNameNumberTitleBlockAndView(sheetName=code_block, sheetNumber=string_from_object_2, titleBlockFamilyType=byName, view=filterByBoolMask.in)
code_block_7 = CodeBlock { " "; }
split = String.Split(getParameterValueByName_2, code_block_7)
length_2 = String.Length(split)
filterByBoolMask_2 = List.FilterByBoolMask()  # unwired: list, mask
code_block_8 = CodeBlock { 1; }
getItemAtIndex = List.GetItemAtIndex(list=split, index=code_block_8)
