# Dynamo graph Duct_Systems.dyn (Dynamo 1.3.0.875)

categories = Categories("DuctCurves")
all_elements_of_category = ElementsOfCategory(categories)
string = StringInput("System Type")
getParameterValueByName = Element.GetParameterValueByName(element=all_elements_of_category, parameterName=string)
string_2 = StringInput("System Name")
getParameterValueByName_2 = Element.GetParameterValueByName(element=all_elements_of_category, parameterName=string_2)
categories_2 = Categories("MEPSpaces")
all_elements_of_category_2 = ElementsOfCategory(categories_2)
string_3 = StringInput("Name")
getParameterValueByName_3 = Element.GetParameterValueByName(element=all_elements_of_category_2, parameterName=string_3)
string_4 = StringInput("Number")
getParameterValueByName_4 = Element.GetParameterValueByName(element=all_elements_of_category_2, parameterName=string_4)
