# Dynamo graph LoadingUpSheetsWithParameters.dyn (Dynamo 1.3.0.875)

categories = Categories("Sheets")
all_elements_of_category = ElementsOfCategory(categories)
code_block = CodeBlock { "Dilatációs / Zóna egység"; }
code_block_2 = CodeBlock { "PFS_eng_rajzpecset_2017_M01"; }
byName = Family.ByName(code_block_2)
types = Family.Types(byName)
name = FamilyType.Name(types)
categories_2 = Categories("TitleBlocks")
all_elements_of_category_2 = ElementsOfCategory(categories_2)
elementType = Element.ElementType(all_elements_of_category_2)
name_2 = Family.Name(elementType)
containsItem = List.ContainsItem(list=name, item=name_2)
code_block_3 = CodeBlock { "XX"; }
if_ = If(test=containsItem, true=name_2, false=code_block_3)
setParameterByName = Element.SetParameterByName(element=all_elements_of_category, parameterName=code_block, value=if_)
code_block_4 = CodeBlock { "Projekt elem"; }
code_block_5 = CodeBlock { "PFS"; }
code_block_6 = CodeBlock { "MUZ"; }
if_2 = If(test=containsItem, true=code_block_5, false=code_block_6)
setParameterByName_2 = Element.SetParameterByName(element=all_elements_of_category, parameterName=code_block_4, value=if_2)
code_block_7 = CodeBlock { "Tervfázis"; "KIV"; }
setParameterByName_3 = Element.SetParameterByName(element=all_elements_of_category, parameterName=code_block_7.out0, value=code_block_7.out1)
code_block_8 = CodeBlock { "Szakág"; "LT"; }
setParameterByName_4 = Element.SetParameterByName(element=all_elements_of_category, parameterName=code_block_8.out0, value=code_block_8.out1)
code_block_9 = CodeBlock { "Szint kód / Épületrész"; }
code_block_10 = CodeBlock { 1; }
categories_3 = Categories("Sheets")
all_elements_of_category_3 = ElementsOfCategory(categories_3)
code_block_11 = CodeBlock { "Sheet Number"; }
getParameterValueByName = Element.GetParameterValueByName(element=all_elements_of_category_3, parameterName=code_block_11)
string_from_object = FromObject(getParameterValueByName)
code_block_12 = CodeBlock { 3; 2; }
substring = String.Substring(str=string_from_object, startIndex=code_block_12.out0, length=code_block_12.out1)
toNumber = String.ToNumber(substring)
add = code_block_10 + toNumber
string_from_object_2 = FromObject(add)
code_block_13 = CodeBlock { 0; "00"; }
insert = String.Insert(str=string_from_object_2, index=code_block_13.out0, toInsert=code_block_13.out1)
setParameterByName_5 = Element.SetParameterByName(element=all_elements_of_category, parameterName=code_block_9, value=insert)
code_block_14 = CodeBlock { "Dokumentum csoport"; "02"; }
setParameterByName_6 = Element.SetParameterByName(element=all_elements_of_category, parameterName=code_block_14.out0, value=code_block_14.out1)
code_block_15 = CodeBlock { "Rajzszám"; "0000"; }
setParameterByName_7 = Element.SetParameterByName(element=all_elements_of_category, parameterName=code_block_15.out0, value=code_block_15.out1)
code_block_16 = CodeBlock { "Revízió"; "M00"; }
setParameterByName_8 = Element.SetParameterByName(element=all_elements_of_category, parameterName=code_block_16.out0, value=code_block_16.out1)
