# Dynamo graph MoveViewports.dyn (Dynamo 1.3.1.1736)

categories = Categories("Viewports")
all_elements_of_category = ElementsOfCategory(categories)

# group: Filter (Dilatáció szerint szétszedve)
code_block = CodeBlock { "View Name"; }
getParameterValueByName = Element.GetParameterValueByName(element=all_elements_of_category, parameterName=code_block)
string_from_object = FromObject(getParameterValueByName)
code_block_2 = CodeBlock { 6; 2; }
substring = String.Substring(str=string_from_object, startIndex=code_block_2.out0, length=code_block_2.out1)
code_block_3 = CodeBlock(str=substring) { str=="D1"; }
filterByBoolMask = List.FilterByBoolMask(list=all_elements_of_category, mask=code_block_3)
code_block_4 = CodeBlock(str=substring) { str=="D2"; }
filterByBoolMask_2 = List.FilterByBoolMask(list=all_elements_of_category, mask=code_block_4)
code_block_5 = CodeBlock(str=substring) { str=="D3"; }
filterByBoolMask_3 = List.FilterByBoolMask(list=all_elements_of_category, mask=code_block_5)
code_block_6 = CodeBlock(str=substring) { str=="D4"; }
filterByBoolMask_4 = List.FilterByBoolMask(list=all_elements_of_category, mask=code_block_6)
code_block_7 = CodeBlock(str=substring) { str=="D5"; }
filterByBoolMask_5 = List.FilterByBoolMask(list=all_elements_of_category, mask=code_block_7)
code_block_8 = CodeBlock(str=substring) { str=="D6"; }
filterByBoolMask_6 = List.FilterByBoolMask(list=all_elements_of_category, mask=code_block_8)
code_block_9 = CodeBlock(str=substring) { str=="D7"; }
filterByBoolMask_7 = List.FilterByBoolMask(list=all_elements_of_category, mask=code_block_9)
code_block_10 = CodeBlock(str=substring) { str=="D8"; }
filterByBoolMask_8 = List.FilterByBoolMask(list=all_elements_of_category, mask=code_block_10)

# group: Coordinate Point Transformation
viewPortBoxCenter = Custom[View.ViewPortBoxCenter](Viewports=filterByBoolMask.in)  # Get ViewPort Box center point
code_block_11 = CodeBlock { -350; -1165; 0; }
byCoordinates = Vector.ByCoordinates(x=code_block_11.out0, y=code_block_11.out1, z=code_block_11.out2)
add = Point.Add(point=viewPortBoxCenter, vectorToAdd=byCoordinates)
setBoxCenter = Custom[Viewport.SetBoxCenter](Points=add, Viewport_list=filterByBoolMask.in)  # API class
viewPortBoxCenter_2 = Custom[View.ViewPortBoxCenter](Viewports=filterByBoolMask_2.in)
code_block_12 = CodeBlock { 340; -1880; 0; }
byCoordinates_2 = Vector.ByCoordinates(x=code_block_12.out0, y=code_block_12.out1, z=code_block_12.out2)
add_2 = Point.Add(point=viewPortBoxCenter_2, vectorToAdd=byCoordinates_2)
setBoxCenter_2 = Custom[Viewport.SetBoxCenter](Points=add_2, Viewport_list=filterByBoolMask_2.in)
viewPortBoxCenter_3 = Custom[View.ViewPortBoxCenter](Viewports=filterByBoolMask_3.in)
code_block_13 = CodeBlock { 340; -1880; 0; }
byCoordinates_3 = Vector.ByCoordinates(x=code_block_13.out0, y=code_block_13.out1, z=code_block_13.out2)
add_3 = Point.Add(point=viewPortBoxCenter_3, vectorToAdd=byCoordinates_3)
setBoxCenter_3 = Custom[Viewport.SetBoxCenter](Points=add_3, Viewport_list=filterByBoolMask_3.in)
viewPortBoxCenter_4 = Custom[View.ViewPortBoxCenter]()  # unwired: Viewports
code_block_14 = CodeBlock { 0; 0; 0; }
byCoordinates_4 = Vector.ByCoordinates(x=code_block_14.out0, y=code_block_14.out1, z=code_block_14.out2)
add_4 = Point.Add(point=viewPortBoxCenter_4, vectorToAdd=byCoordinates_4)
setBoxCenter_4 = Custom[Viewport.SetBoxCenter](Points=add_4, Viewport_list=filterByBoolMask_4.in)
viewPortBoxCenter_5 = Custom[View.ViewPortBoxCenter]()  # unwired: Viewports
code_block_15 = CodeBlock { 0; 0; 0; }
byCoordinates_5 = Vector.ByCoordinates(x=code_block_15.out0, y=code_block_15.out1, z=code_block_15.out2)
add_5 = Point.Add(point=viewPortBoxCenter_5, vectorToAdd=byCoordinates_5)
setBoxCenter_5 = Custom[Viewport.SetBoxCenter](Points=add_5, Viewport_list=filterByBoolMask_5.out)
viewPortBoxCenter_6 = Custom[View.ViewPortBoxCenter]()  # unwired: Viewports
code_block_16 = CodeBlock { 0; 0; 0; }
byCoordinates_6 = Vector.ByCoordinates(x=code_block_16.out0, y=code_block_16.out1, z=code_block_16.out2)
add_6 = Point.Add(point=viewPortBoxCenter_6, vectorToAdd=byCoordinates_6)
setBoxCenter_6 = Custom[Viewport.SetBoxCenter](Points=add_6, Viewport_list=filterByBoolMask_6.out)
viewPortBoxCenter_7 = Custom[View.ViewPortBoxCenter]()  # unwired: Viewports
code_block_17 = CodeBlock { 0; 0; 0; }
byCoordinates_7 = Vector.ByCoordinates(x=code_block_17.out0, y=code_block_17.out1, z=code_block_17.out2)
add_7 = Point.Add(point=viewPortBoxCenter_7, vectorToAdd=byCoordinates_7)
setBoxCenter_7 = Custom[Viewport.SetBoxCenter](Points=add_7, Viewport_list=filterByBoolMask_7.out)
viewPortBoxCenter_8 = Custom[View.ViewPortBoxCenter]()  # unwired: Viewports
code_block_18 = CodeBlock { 0; 0; 0; }
byCoordinates_8 = Vector.ByCoordinates(x=code_block_18.out0, y=code_block_18.out1, z=code_block_18.out2)
add_8 = Point.Add(point=viewPortBoxCenter_8, vectorToAdd=byCoordinates_8)
setBoxCenter_8 = Custom[Viewport.SetBoxCenter](Points=add_8, Viewport_list=filterByBoolMask_8.out)
