# Dynamo graph Renaming Sheets.dyn (Dynamo 1.3.0.875)

code_block = CodeBlock { "Projekt elem"; }
code_block_2 = CodeBlock { "Tervfázis"; }
code_block_3 = CodeBlock { "Szakág"; }
code_block_4 = CodeBlock { "Dilatációs / Zóna egység"; }
code_block_5 = CodeBlock { "Szint kód / Épületrész"; }
code_block_6 = CodeBlock { "Dokumentum csoport"; }
code_block_7 = CodeBlock { "Rajzszám"; }
code_block_8 = CodeBlock { "Revízió"; }

# group: Getting parameters from project
categories = Categories("Sheets")
all_elements_of_category = ElementsOfCategory(categories)
parameterByName = Parameter.ParameterByName(element=all_elements_of_category, name=code_block)
value = Parameter.Value(parameterByName)
parameterByName_2 = Parameter.ParameterByName(element=all_elements_of_category, name=code_block_2)
value_2 = Parameter.Value(parameterByName_2)
parameterByName_3 = Parameter.ParameterByName(element=all_elements_of_category, name=code_block_3)
value_3 = Parameter.Value(parameterByName_3)
parameterByName_4 = Parameter.ParameterByName(element=all_elements_of_category, name=code_block_4)
value_4 = Parameter.Value(parameterByName_4)
parameterByName_5 = Parameter.ParameterByName(element=all_elements_of_category, name=code_block_5)
value_5 = Parameter.Value(parameterByName_5)
parameterByName_6 = Parameter.ParameterByName(element=all_elements_of_category, name=code_block_6)
value_6 = Parameter.Value(parameterByName_6)
parameterByName_7 = Parameter.ParameterByName(element=all_elements_of_category, name=code_block_7)
value_7 = Parameter.Value(parameterByName_7)
parameterByName_8 = Parameter.ParameterByName(element=all_elements_of_category, name=code_block_8)
value_8 = Parameter.Value(parameterByName_8)
create = List.Create(value, value_2, value_3, value_4, value_5, value_6, value_7, value_8)

watch = Watch(create)

# group: Merging parameters
code_block_9 = CodeBlock { "-"; }
transpose = List.Transpose(create)
join = String.Join(code_block_9, transpose)
flatten = Flatten(join)

watch_2 = Watch(join)

# group: Load new parameter value into model
code_block_10 = CodeBlock { "Sheet Number"; }
setParameterByName = Element.SetParameterByName(element=all_elements_of_category, parameterName=code_block_10, value=flatten)

watch_3 = Watch(setParameterByName)
watch_4 = Watch(flatten)
