# Dynamo graph Rotate Sheets.dyn (Dynamo 1.3.0.875)

# group: Selection Basket
categories = Categories("Views")
all_elements_of_category = ElementsOfCategory(categories)

code_block = CodeBlock {  }
code_block_2 = CodeBlock { "None"; "CW"; "CCW"; }

# group: Selection Basket
categories_2 = Categories("Viewports")
all_elements_of_category_2 = ElementsOfCategory(categories_2)

# group: Filter - [Stadion légtecnika rendszer, D1-D8 dilatációkhoz tartoznak]
getParameterValueByName = Element.GetParameterValueByName(element=all_elements_of_category)  # unwired: parameterName
string_from_object = FromObject(getParameterValueByName)
code_block_3 = CodeBlock { "LT"; }
startsWith = String.StartsWith(str=string_from_object, searchFor=code_block_3)
string_from_object_2 = FromObject(getParameterValueByName)
length = String.Length(string_from_object_2)
code_block_4 = CodeBlock(length=length) { length==8; }
and_ = startsWith && code_block_4
getParameterValueByName_2 = Element.GetParameterValueByName(element=all_elements_of_category)  # unwired: parameterName
string_from_object_3 = FromObject(getParameterValueByName_2)
code_block_5 = CodeBlock(str=string_from_object_3) { str=="Múzeum"; }
not_ = Not(code_block_5)
and_2 = and_ && not_
filterByBoolMask = List.FilterByBoolMask(list=all_elements_of_category, mask=and_2)
code_block_6 = CodeBlock { "View Name"; }
getParameterValueByName_3 = Element.GetParameterValueByName(element=all_elements_of_category_2, parameterName=code_block_6)
string_from_object_4 = FromObject(getParameterValueByName_3)
code_block_7 = CodeBlock { "LT"; }
startsWith_2 = String.StartsWith(str=string_from_object_4, searchFor=code_block_7)
string_from_object_5 = FromObject(getParameterValueByName_3)
length_2 = String.Length(string_from_object_5)
code_block_8 = CodeBlock(length=length_2) { length==8; }
and_3 = startsWith_2 && code_block_8
code_block_9 = CodeBlock { "Phase Filter"; }
getParameterValueByName_4 = Element.GetParameterValueByName(element=all_elements_of_category_2, parameterName=code_block_9)
string_from_object_6 = FromObject(getParameterValueByName_4)
code_block_10 = CodeBlock(str=string_from_object_6) { str=="Múzeum"; }
not_2 = Not(code_block_10)
and_4 = and_3 && not_2
filterByBoolMask_2 = List.FilterByBoolMask(list=all_elements_of_category_2, mask=and_4)

rotate_sheets_pyton_script = Python(IN[0]=code_block_2.out2, IN[1]=filterByBoolMask_2.in)
# ---------- rotate_sheets_pyton_script.python (19 lines) ----------
import clr
clr.AddReference('RevitServices')
from RevitServices.Persistence import DocumentManager
from RevitServices.Transactions import TransactionManager
doc = DocumentManager.Instance.CurrentDBDocument

clr.AddReference('RevitAPI')
from Autodesk.Revit.DB import *
rot_enum = {'None' : ViewportRotation.None,
            'CW' : ViewportRotation.Clockwise,
            'CCW' : ViewportRotation.Counterclockwise}
viewports = UnwrapElement(IN[1])
rot = IN[0]
rotation = rot_enum[rot]
TransactionManager.Instance.EnsureInTransaction(doc)
for v in viewports:
    v.Rotation = rotation
TransactionManager.Instance.TransactionTaskDone()
OUT = 0
# ----------------------------------------
